# Grasshopper definition VisualizeDataExample.gh (Grasshopper 1.0.7)
# plug-ins: VisFroG

path = FilePath("..\example\ExampleData.csv")
file = ReadFile(File=path, PerLineParse=True)
panel = Panel(""",
 """)
split = SplitList(List=file, Index="1")  # -> ListA, ListB
split_2 = TextSplit(Text=file, Separators=panel)
panel_2 = Panel(split.ListA)
panel_3 = Panel(split_2)
visfrog = VISualizationFRameworkFOrGrasshopper(GenericInputData=split_2)  # -> GenericOutputData, DebugOutput
