# Grasshopper definition example.gh (Grasshopper 1.0.7)
# plug-ins: VisuAlFroG

input_data_path = Panel("..\example\example-data.csv")
path = FilePath(input_data_path)
separator = Panel(";")
file = ReadFile(File=path, PerLineParse=True)
split = TextSplit(Text=file, Separators=separator)
panel = Panel(split)
command_line_arguments = Panel("--config ..\example\visualfrog_configuration.json")
visualfrog = VisualAnalyticsFrameworkForGrasshopper(GenericInputData=split, CommandLineArguments=command_line_arguments)
output = Panel(visualfrog)
